# Dynamo graph OntoBIM_Manchester_2024.dyn (Dynamo 2.18.1.5096)

# group: Construtor Ontológico OWL - Revit 2024 - Fluxo Geral - V2.0 > Construtor Ontológico OWL - Revit 2024 - Funções - V2.0
# Desenvolvido por: prof. José Luis Menegotto
# Escola Politécnica da UFRJ
# Departamento de Expressão Gráfica
# Universidade Federal do Rio de Janeiro
função_formação_de_fato = CodeBlock()
# ---------- função_formação_de_fato.designscript (8 lines) ----------
def Fato ( fat , f1 , f2 )
{
  celu   = f1 + " " + f2;
  abce   = fat + celu;
  cond   = String.Contains(celu,"null");
  final  = cond == true ? "" : abce;
  return = final;
};
# ----------------------------------------
função_lee_o_arquivo_excel = CodeBlock()
# ---------- função_lee_o_arquivo_excel.designscript (8 lines) ----------
def LerExcel ( Arq , Tab )
{
   dadosIn = DSOffice.Data.ImportExcel(Arq, Tab, true, false);
   valores = List.DropItems( dadosIn , 1    );
   dadosTr = List.Transpose( valores        );
   dadosOu = List.Clean    ( dadosTr , true );
   return dadosOu;
};
# ----------------------------------------
função_concatenar_resultados = CodeBlock()  # "Função - Concatenar Resultados Únicos"
# ---------- função_concatenar_resultados.designscript (8 lines) ----------
def Unicos ( S , n)
{
    LF  = List.Flatten     ( S , n);
    LU  = List.UniqueItems ( LF   );
    ST  = String.Concat    ( LU   );

    return = ST;
};
# ----------------------------------------
função_formar_as_equivalências = CodeBlock()
# ---------- função_formar_as_equivalências.designscript (18 lines) ----------
def EqVt ( fx,  txt , AXI )
{
    Axi = Nula ( txt , AXI );
    s   = String.Split( Axi , " ");
    str = String.Contains (s, "Equiv",0)? s+" "    :
          String.Contains (s, "Inver",0)? s+" "    :
          (s == "some"||
           s == "only"||
           s == "and" ||
           s == "or"  ||
           s == "("   ||
           s == ")"   ||
           s == "Min" ||
           s == "Max" ||
           s == "Exactly" )      ? " "+s+" ":
           List.Count(s)>0       ? " "+fx+s :"";
    return = String.Concat( [ str ] );
};
# ----------------------------------------
função_célula_de_excel_é_null = CodeBlock()
# ---------- função_célula_de_excel_é_null.designscript (8 lines) ----------
def Nula ( txt , LIS )
{
  celu   = LIS;
  abce   = txt + celu;
  cond   = String.Contains(celu,"null");
  final  = cond == true ? "" : abce;
  return = final;
};
# ----------------------------------------

# group: Construtor Ontológico OWL - Revit 2024 - Fluxo Geral - V2.0
# Desenvolvido por: prof. José Luis Menegotto
# Escola Politécnica da UFRJ
# Departamento de Expressão Gráfica
# Universidade Federal do Rio de Janeiro
escolher_o_arquivo_excel_com_a = Filename(".\Ontologia_NBR_6492-2021_V2.00.xlsx")  # "Escolher o arquivo Excel com a estrutura da Ontologia"
# note: O Construtor precisa fazer a leitura de um arquivo Excel que contem o Campo Ontológico completo com as hierarquias das classes, as equivalências, as propriedades, características e definiçoes terminológias de Propriedades dos Objetos e dos Dados.
# O arquivo Excell pode ser modificado pelo usuário para configurar uma estruturação ontológica de acordo ao seu dominio de conhecimentos e tema de interesse.
# O sistema fica disponível para uso e testes desde que citada a fonte.
# Prof. José Luis Menegotto.
# Escola Politécnica da UFRJ
# PEU - Programa de Pós-graduação em Engenharia Urbana
# PPE - Programa de Pós-graduação em Estrutura
# LEIA COM ATENÇAO:
# 1) A coluna F com as Classes (5) não pode ter elementos repetidos.
# 2) Nenhuma Classe ou Propriedade pode ter Espaços. Foi utilizado o ponto como separador.
# 3)Nomes de Classes em maiúscula
# 4)Nomes de propriedades em minúscula
# 5)Os fatos devem ser extraídos diretamente do modelo. Este nodo é utilizado para testar a formação sintática dos diversos axiomas.
file_from_path = FileObject(path=escolher_o_arquivo_excel_com_a)
leitura_de_dados_e_preparação_de = CodeBlock(AXLS=file_from_path)  # "LEITURA DE DADOS E PREPARAÇÃO DE ELEMENTOS TEXTUAIS"
# ---------- leitura_de_dados_e_preparação_de.designscript (75 lines) ----------
AXLS;
DaPRJ = LerExcel (AXLS , "ProjInfo"  );
DadTC = LerExcel (AXLS , "AsClasses" );
DadTP = LerExcel (AXLS , "AsProprie" );
DadFA = LerExcel (AXLS , "OsFatosIn" );
DadDI = LerExcel (AXLS , "AsDisjunt" );

key   = ["DAPRJ","DACLA","DAPRO","DAFAT","DADIS"];
val   = [ DaPRJ , DadTC , DadTP , DadFA , DadDI ];
DADOS = Dictionary.ByKeysValues (key , val);
//-------------------------------------------------
// SAIDAS
//-------------------------------------------------
DADOS;
DCLA;
DDOM;
DANO;
DESP;
DCAR;
DFAT;
//-------------------------------------------------
//Classes e propriedades --------------------------
clas = "\n\nClass: ";
subc = "\n\tSubClassOf: ";
obje = "\n\nObjectProperty: ";
subp = "\n\tSubPropertyOf: ";
data = "\n\nDataProperty: ";
//Dominio -----------------------------------------
domi = "\n\tDomain: ";
rang = "\n\tRange: ";
equi = "\n\tEquivalentTo: ";
//Individuos --------------------------------------
chav = "\n\tHasKey: ";
indi = "\n\nIndividual: ";
tipo = "\n\tTypes: ";
fato = "\n\tFacts: ";
impo = "\n\nImport: ";
//Disjunções --------------------------------------
anot = "\n\tAnnotations: rdfs:label   \"";
help = "\n\tAnnotations: rdfs:comment \"";
disc = "\n\nDisjointClasses: ";
disu = "\n\tDisjointUnionOf: ";
disj = "\n\tDisjointWith: ";
//Espaciais ---------------------------------------
aspa = "\"";
espa = "\n";
id   = aspa+"@pt";
vi   = ", ";
//Caracteristicas ---------------------------------
cara = "\n\tCharacteristics: ";
inve = "\n\tInverseOf: ";
// Dicionário Classes e propriedades --------------
kax  = ["clas","subc","obje","subp","data"];
vax  = [ clas , subc , obje , subp , data ];
DCLA = Dictionary.ByKeysValues( kax , vax );
// Dicionário de Dominio --------------------------
kdo  = ["domi","rang","equi"];
vdo  = [ domi , rang , equi];
DDOM = Dictionary.ByKeysValues( kdo , vdo );
// Dicionário de Anotações-------------------------
kan  = ["anot","help","disc","disu","disj"];
van  = [ anot , help , disc , disu , disj ];
DANO = Dictionary.ByKeysValues( kan , van );
// Dicionário de Espaciais ------------------------
kes  = ["aspa","espa","idio","virg"];
ves  = [ aspa , espa , id   , vi   ];
DESP = Dictionary.ByKeysValues( kes , ves );
// Dicionário de Caracteristicas ------------------
kca  = ["cara","inve"];
vca  = [ cara , inve ];
DCAR = Dictionary.ByKeysValues( kca, vca );
// Dicionário de Individuos -----------------------
kin  = ["chav","indi","tipo","fato","impo"];
vin  = [ chav , indi , tipo , fato , impo ];
DFAT = Dictionary.ByKeysValues( kin , vin );
# ----------------------------------------
formação_dos_axiomas_ontológicos = CodeBlock(DADOS=leitura_de_dados_e_preparação_de.out9, DCLA=leitura_de_dados_e_preparação_de.out10, DDOM=leitura_de_dados_e_preparação_de.out11, DANO=leitura_de_dados_e_preparação_de.out12, DESP=leitura_de_dados_e_preparação_de.out13, DCAR=leitura_de_dados_e_preparação_de.out14, DFAT=leitura_de_dados_e_preparação_de.out15)
# ---------- formação_dos_axiomas_ontológicos.designscript (75 lines) ----------
DADOS;
DCLA;
DDOM;
DANO;
DESP;
DCAR;
DFAT;
DicI;
//----------------------------------------------------------
// Prepara Informações do Projeto
//----------------------------------------------------------
DPJT = DADOS["DAPRJ"];
DACL = DADOS["DACLA"];
DPRO = DADOS["DAPRO"];
DISJ = DADOS["DADIS"];
keyP = DPJT [0];
valP = DPJT [1];
fx   = valP [0];
tema = valP [1];
rzcl = valP [2];
rzpr = valP [3];
rzda = valP [4];
uri  = valP [5];
aut  = valP [6];
clas = DCLA ["clas"]+fx;
subc = DCLA ["subc"]+fx;
obje = DCLA ["obje"]+fx;
data = DCLA ["data"]+fx;
equi = DDOM ["equi"]+fx;
help = DANO ["help"];
aspa = DESP ["aspa"];
vi   = DESP ["virg"];
id   = DESP ["idio"];
//----------------------------------------------------------
// Prepara Prefixos e Raizes
//----------------------------------------------------------
qo   = List.Count(keyP)-1;
io   = 0..qo;
fo   = qo==io?"":vi;
PRFX =
"\nPrefix: owl:  <http://www.w3.org/2002/07/owl#>"             +
"\nPrefix: rdfs: <http://www.w3.org/2000/01/rdf-schema#>"      +
"\nPrefix: foaf: <http://xmlns.com/foaf/0.1/#>"                +
"\nPrefix: rdf:  <http://www.w3.org/1999/02/22-rdf-syntax-ns#>"+
"\nPrefix: xsd:  <http://www.w3.org/2001/XMLSchema#>"          +
"\nPrefix: skos: <http://www.w3.org/2004/02/skos/core#>"       +
"\nPrefix: dc:   <http://purl.org/dc/elements/1.1/>"           +
"\nPrefix: tem:  <http://www.w3.org/2006/time#>"               +
"\nPrefix: "+fx+" <"+uri     +">"+
"\n\nOntology: <"   +uri+tema+">";

ETIQ = "\n\trdfs:label " +aspa+keyP + ": " +valP+id+fo;
CABE = "\n\nAnnotations: " + String.Concat( [ ETIQ ] );
ANOT = "\n\nDatatype: xsd:string"       +
         "\nDatatype: xsd:decimal"      +
         "\nDatatype: xsd:double"       +
         "\nDatatype: rdfs:Literal"     +
         "\nDatatype: rdf:PlainLiteral" +
         "\nDatatype: xsd:integer"      +
         "\nDatatype: xsd:dateTime"     +
         "\nDatatype: xsd:boolean";

RAIZ = clas+rzcl+help+ "Raiz das Classes"     +id+
       obje+rzpr+help+ "Raiz das Propriedades"+id+
       data+rzda+help+ "Raiz dos Data"        +id;

CLA =       clas+DACL[1];
SUB =       subc+rzcl;
HEL = Nula (help , DACL[11]);
LIN = CLA+SUB+HEL+id;
CLI = Unicos( LIN , 2);

key  = ["TEMA", "PREF", "CABE", "ANOT", "RAIZ", "CLAI"];
val  = [ tema ,  PRFX ,  CABE ,  ANOT ,  RAIZ ,  CLI  ];
DicI = Dictionary.ByKeysValues (key , val);
# ----------------------------------------
preparação_das_classes = CodeBlock(DADOS=formação_dos_axiomas_ontológicos.out0, DCLA=formação_dos_axiomas_ontológicos.out1, DDOM=formação_dos_axiomas_ontológicos.out2, DANO=formação_dos_axiomas_ontológicos.out3, DESP=formação_dos_axiomas_ontológicos.out4, DCAR=formação_dos_axiomas_ontológicos.out5, DFAT=formação_dos_axiomas_ontológicos.out6, DicI=formação_dos_axiomas_ontológicos.out7)
# ---------- preparação_das_classes.designscript (44 lines) ----------
DADOS;
DCLA;
DDOM;
DANO;
DESP;
DCAR;
DFAT;
DicI;
DicC;
//-----------------------------------
// Prepara dados do Classes
//-----------------------------------
DPJT = DADOS["DAPRJ"];
DACL = DADOS["DACLA"];
DPRO = DADOS["DAPRO"];
DISJ = DADOS["DADIS"];
keyP = DPJT [0];
valP = DPJT [1];
fx   = valP [0];
clas = DCLA ["clas"];
subc = DCLA ["subc"];
equi = DDOM ["equi"];
help = DANO ["help"];
id   = DESP ["idio"];
vi   = DESP ["virg"];
disc = DANO ["disc"];
//-----------------------------------
// CLASSES
//-----------------------------------
c    = 2..5;
CLAS =          clas+fx+DACL[c   ];
OSUB =          subc+fx+DACL[c- 1];
EQUI = EqVt (fx,equi  , DACL[c+ 5]);
//EQUI = "";
HELP = Nula (   help  , DACL[c+10]);
//-----------------------------------
OCLA = CLAS+OSUB+HELP+id+EQUI;
UCLA = Unicos ( OCLA , 2);
//-----------------------------------
// REGISTRA FINAIS DE CLASSES
//-----------------------------------
kc   = [ "CLAS" ];
vc   = [  UCLA  ];
DicC = Dictionary.ByKeysValues(kc,vc);
# ----------------------------------------
preparação_das_propriedades = CodeBlock(DADOS=preparação_das_classes.out0, DCLA=preparação_das_classes.out1, DDOM=preparação_das_classes.out2, DANO=preparação_das_classes.out3, DESP=preparação_das_classes.out4, DCAR=preparação_das_classes.out5, DFAT=preparação_das_classes.out6, DicI=preparação_das_classes.out7, DicC=preparação_das_classes.out8)
# ---------- preparação_das_propriedades.designscript (73 lines) ----------
DADOS;
DCLA;
DDOM;
DANO;
DESP;
DCAR;
DFAT;
DicI;
DicC;
DicP;
//-----------------------------------
// Prepara dados de Propriedades
//-----------------------------------
DPJT = DADOS["DAPRJ"];
DACL = DADOS["DACLA"];
DPRO = DADOS["DAPRO"];
keyP = DPJT [0];
valP = DPJT [1];
fx   = valP [0];
obje = DCLA ["obje"]+fx;
suop = DCLA ["subp"]+fx;
sudp = DCLA ["subp"]+fx;
data = DCLA ["data"]+fx;
anot = DANO ["anot"];
equi = DDOM ["equi"]+fx;
domi = DDOM ["domi"]+fx;
rang = DDOM ["rang"]+fx;
vran = DDOM ["rang"];
help = DANO ["help"];
vi   = DESP ["virg"];
id   = DESP ["idio"];
cara = DCAR ["cara"];
inve = DCAR ["inve"];
//-----------------------------------
// PROPRIEDADES DOS OBJETOS
//-----------------------------------
PROP =          obje + DPRO[ 5];
OSUB =          suop + DPRO[ 4];
CA01 = Nula (   cara , DPRO[ 6]);
CA02 = Nula (   cara , DPRO[ 7]);
CA03 = Nula (   cara , DPRO[ 8]);
CA04 = Nula (   cara , DPRO[ 9]);
CA05 = Nula (   cara , DPRO[10]);
CA06 = Nula (   cara , DPRO[11]);
CA07 = Nula (   cara , DPRO[12]);
CA08 = EqVt (fx,inve , DPRO[13]);
DOMI = Nula (   domi , DPRO[14]);
RANG = Nula (   rang , DPRO[15]);
HELP =          help + DPRO[16];
//-----------------------------------
OPRO = PROP+OSUB+
       CA01+CA02+CA03+CA04+CA05+CA06+
       CA07+CA08+DOMI+RANG+HELP+id;
OPRU = Unicos ( OPRO , 2);
//-----------------------------------
// DATA DOS OBJETOS
//-----------------------------------
DATA =        data + DPRO[  2];
DASU =        sudp + DPRO[  1];
DAHE =        help + DPRO[ 17];
COME =        anot + DPRO[ 19];
DADO = Nula ( domi , DPRO[ 14]);
DARA = Nula ( vran , DPRO[  3]);
DACA = Nula ( cara , DPRO[ 18]);
ODAT = DATA+DASU+DADO+DARA+
       DACA+DAHE+id+COME+id;
ODAU = Unicos ( ODAT , 2);
//-----------------------------------
// REGISTRA FINAIS DE PROPRIEDADES
//-----------------------------------
kp   = ["PROP", "DATA"];
vp   = [ OPRU ,  ODAU ];
DicP = Dictionary.ByKeysValues(kp,vp);
# ----------------------------------------
preparação_das_disjuntas = CodeBlock(DADOS=preparação_das_propriedades.out0, DCLA=preparação_das_propriedades.out1, DDOM=preparação_das_propriedades.out2, DANO=preparação_das_propriedades.out3, DESP=preparação_das_propriedades.out4, DCAR=preparação_das_propriedades.out5, DFAT=preparação_das_propriedades.out6, DicI=preparação_das_propriedades.out7, DicC=preparação_das_propriedades.out8, DicP=preparação_das_propriedades.out9)
# ---------- preparação_das_disjuntas.designscript (56 lines) ----------
DADOS;
DCLA;
DDOM;
DANO;
DESP;
DCAR;
DFAT;
DicI;
DicC;
DicP;
DicD;
//-----------------------------------
// Prepara dados de Disjuntas
//-----------------------------------
DPJT = DADOS["DAPRJ"];
DISJ = DADOS["DADIS"];
keyP = DPJT [0];
valP = DPJT [1];
fx   = valP [0];
vi   = DESP ["virg"];
disc = DANO ["disc"];
//-----------------------------------
// DISJUNTAS até 9
//-----------------------------------
DJ1  = Nula (    fx, DISJ[  1 ]);
DJ2  = Nula ( vi+fx, DISJ[  2 ]);
DJ3  = Nula ( vi+fx, DISJ[  3 ]);
DJ4  = Nula ( vi+fx, DISJ[  4 ]);
DJ5  = Nula ( vi+fx, DISJ[  5 ]);
DJ6  = Nula ( vi+fx, DISJ[  6 ]);
DJ7  = Nula ( vi+fx, DISJ[  7 ]);
DJ8  = Nula ( vi+fx, DISJ[  8 ]);
DJ9  = Nula ( vi+fx, DISJ[  9 ]);
DJ10 = Nula ( vi+fx, DISJ[ 10 ]);
DJ11 = Nula ( vi+fx, DISJ[ 11 ]);
DJ12 = Nula ( vi+fx, DISJ[ 12 ]);
DJ13 = Nula ( vi+fx, DISJ[ 13 ]);
DJ14 = Nula ( vi+fx, DISJ[ 14 ]);
DJ15 = Nula ( vi+fx, DISJ[ 15 ]);
DJ16 = Nula ( vi+fx, DISJ[ 16 ]);
DJ17 = Nula ( vi+fx, DISJ[ 17 ]);
DJ18 = Nula ( vi+fx, DISJ[ 18 ]);
DJ19 = Nula ( vi+fx, DISJ[ 19 ]);
DJ20 = Nula ( vi+fx, DISJ[ 20 ]);
//-----------------------------------
ODJ = disc+DJ1 +DJ2 +DJ3 +DJ4 +DJ5 +
           DJ6 +DJ7 +DJ8 +DJ9 +DJ10+
           DJ11+DJ12+DJ13+DJ14+DJ15+
           DJ16+DJ17+DJ18+DJ19+DJ20;
UDJ = Unicos ( ODJ , 3);
//-----------------------------------
// REGISTRA FINAIS DE DISJUNTAS
//-----------------------------------
kj   = ["DISJ"];
vj   = [ UDJ  ];
DicD = Dictionary.ByKeysValues(kj,vj);
# ----------------------------------------
preparação_dos_fatos_de = CodeBlock(DADOS=preparação_das_disjuntas.out0, DCLA=preparação_das_disjuntas.out1, DDOM=preparação_das_disjuntas.out2, DANO=preparação_das_disjuntas.out3, DESP=preparação_das_disjuntas.out4, DCAR=preparação_das_disjuntas.out5, DFAT=preparação_das_disjuntas.out6, DicI=preparação_das_disjuntas.out7, DicC=preparação_das_disjuntas.out8, DicP=preparação_das_disjuntas.out9, DicD=preparação_das_disjuntas.out10)  # "PREPARAÇÃO DOS FATOS DE INDIVÍDUOS"
# ---------- preparação_dos_fatos_de.designscript (75 lines) ----------
DADOS;
DCLA;
DDOM;
DANO;
DESP;
DCAR;
DFAT;
DicI;
DicC;
DicP;
DicD;
//-----------------------------------
// Prepara dados de Fatos
//-----------------------------------
DPJT = DADOS["DAPRJ"];
DIFA = DADOS["DAFAT"];
keyP = DPJT [0];
valP = DPJT [1];
fx   = valP [0];
id   = DESP ["idio"];
help = DANO ["help"];
indi = DFAT ["indi"];
tipo = DFAT ["tipo"];
fato = DFAT ["fato"];
//-----------------------------------
// FATOS DE INDIVIDUOS
//-----------------------------------
IFA = indi+     fx+DIFA[ 1];
TFA = tipo+     fx+DIFA[ 2];
FA1 = Fato(fato,fx+DIFA[ 3],fx+DIFA[ 4]);
FA2 = Fato(fato,fx+DIFA[ 5],   DIFA[ 6]);
FA3 = Fato(fato,fx+DIFA[ 7],   DIFA[ 8]);
FA4 = Fato(fato,fx+DIFA[ 9],   DIFA[10]);
FA5 = Fato(fato,fx+DIFA[11],   DIFA[12]);
FA6 = Fato(fato,fx+DIFA[13],   DIFA[14]);
HFA = help+        DIFA[ 1]+id;
//-----------------------------------
FAT = IFA+TFA+HFA+FA1+FA2+FA3+
                  FA4+FA5+FA6;
UFA = Unicos( FAT , 2);
//-----------------------------------
// REGISTRA FINAIS DE FATOS
//-----------------------------------
kf   = ["FATO"];
vf   = [ UFA  ];
DicF = Dictionary.ByKeysValues(kf,vf);
//-----------------------------------
// ID PASTA e TEMA
//-----------------------------------
di1  = "C:\\ABNT_Normas\\ABNT";
di2  = "\\Para_Desenho\\OntoBIM_";
tema =  DicI["TEMA"];
Nume = "1000";
Aowl = di1+di2+tema+"_"+Nume+".OWL";
//---------------------------------
// REGISTRA TODO
//---------------------------------
TODO = [  DicI["PREF"]
        , DicI["CABE"]
        , DicI["ANOT"]
        , DicI["RAIZ"]
        , DicI["CLAI"]
        , DicC["CLAS"]
        , DicP["PROP"]
        , DicP["DATA"]
       // , DicD["DISJ"]
        , DicF["FATO"]
       ];
UTEXT = String.Concat(
         List.UniqueItems(
          List.Flatten(TODO,3)));
//---------------------------------
// ESCREVE ARQUIVO OWL
//---------------------------------
FileSystem.WriteText ( Aowl , UTEXT);
# ----------------------------------------
