# Dynamo graph OntoBIM_Manchester.dyn (Dynamo 2.16.1.2727)

# group: Construtor de uma Ontologia OWL - Revit 2023
# Desenvolvido por: prof. José Luis Menegotto - Escola Politécnica da UFRJ - Departamento de Expressão Gráfica
# note: O Construtor precisa fazer a leitura de um arquivo Excel que contem a hierarquia de classes, propriedades e instâncias utilizadas.
# Esse arquivo pode ser modificado pelo usuário para configurar a ontologia de acordo ao seu dominio de conhecimentos.
file_path = Filename(".\Ontologia_Ambientes.xlsx")
file_from_path = FileObject(path=file_path)
leitura_do_excel = CodeBlock(ArqXLS=file_from_path)
# ---------- leitura_do_excel.designscript (11 lines) ----------
ArqXLS;
DadJ  = List.DropItems(DSOffice.Data.ImportExcel(ArqXLS, "ProjInfo" ,true,false),1);
DadC  = List.DropItems(DSOffice.Data.ImportExcel(ArqXLS, "AsClasses",true,false),1);
DadP  = List.DropItems(DSOffice.Data.ImportExcel(ArqXLS, "AsProprie",true,false),1);
DadI  = List.DropItems(DSOffice.Data.ImportExcel(ArqXLS, "AsInstanc",true,false),1);
DadD  = List.DropItems(DSOffice.Data.ImportExcel(ArqXLS, "AsDisjunt",true,false),1);
DaPRJ = List.Clean ( List.Transpose( DadJ ), true);
DadTC = List.Clean ( List.Transpose( DadC ), true);
DadTP = List.Clean ( List.Transpose( DadP ), true);
DadTI = List.Clean ( List.Transpose( DadI ), true);
DadDI = List.Clean ( List.Transpose( DadD ), true);
# ----------------------------------------
formação_dos_axiomas_ontológicos = CodeBlock(DaPRJ=leitura_do_excel.DaPRJ, DadTC=leitura_do_excel.DadTC, DadTP=leitura_do_excel.DadTP, DadTI=leitura_do_excel.DadTI, DadDI=leitura_do_excel.DadDI)
# ---------- formação_dos_axiomas_ontológicos.designscript (106 lines) ----------
DaPRJ;
DadTC;
DadTP;
DadTI;
DadDI;
A1   = "\"";
A2   = A1+"@pt";
vi   = ", ";
Nulo = "Vnulo";
anot = "\n\tAnnotations: rdfs:label "  +A1;
help = "\n\tAnnotations: rdfs:comment "+A1;
clas = "\n\nClass: ";
subc = "\n\tSubClassOf: ";
obje = "\n\nObjectProperty: ";
data = "\n\nDataProperty: ";
subp = "\n\tSubPropertyOf: ";
cara = "\n\tCharacteristics: ";
domi = "\n\tDomain: ";
rang = "\n\tRange: ";
inve = "\n\tInverseOf: ";
indi = "\n\nIndividual: ";
tipo = "\n\tTypes: ";
equi = "\n\tEquivalentTo: ";
chav = "\n\tHasKey: ";
disu = "\n\tDisjointUnionOf: ";
fato = "\n\tFacts: ";
disj = "\n\tDisjointWith: ";
disc = "\n\nDisjointClasses: ";
impo = "\n\nImport: ";
//------------------------------------------------------------------------
// Prepara Informações do Projeto
//------------------------------------------------------------------------
keyP = DaPRJ[0];
valP = DaPRJ[1];
fx   = valP[0];
tema = valP[1];
qo   = List.Count(keyP)-1;
io   = 0..qo;
fo   = qo==io?"":vi;
ONTO = "\n\trdfs:label " +A1+keyP+ ": "+valP+A2+fo;
OTXT =
"\n\nOntology: <https://jlmenegotto.wixsite.com/jlmenegotto-bim#"+tema+">"+
"\n\nAnnotations: " +
"\n\tdc:title "+A1+"Ontologia BIM"      +A2+vi+
"\n\tdc:title "+A1+"Autor: JL Menegotto"+A2+vi+String.Concat([ONTO]);
//------------------------------------------------------------------------
// Prepara CLASSES: Classe c Subclasse c-1
//------------------------------------------------------------------------
c   = 2..5;
CAN = anot + fx+DadTC[c]+A2;
CCL = clas + fx+DadTC[c]+subc+fx+DadTC[c-1];
CDE = String.Contains(DadTC[c+9],Nulo)==true?"":help+DadTC[c+9]+A2;
CEQ = String.Contains(DadTC[c+4],Nulo)==true?"":equi+DadTC[c+4];
CLA = CCL+CAN+CDE+CEQ;
//------------------------------------------------------------------------
// Prepara PROPRIEDADES DOS OBJETOS E DADOS
//------------------------------------------------------------------------
DAN = anot + fx+DadTP[ 2 ]+A2;
PAN = anot + fx+DadTP[ 3 ]+A2;
DAT = data + fx+DadTP[ 2 ]+ subp +fx+DadTP[ 1 ];
PRP = obje + fx+DadTP[ 3 ]+ subp +fx+DadTP[ 1 ];
PC1 = String.Contains(DadTP[ 4],Nulo)==true?"":cara+   DadTP[ 4];
PC2 = String.Contains(DadTP[ 5],Nulo)==true?"":cara+   DadTP[ 5];
PC3 = String.Contains(DadTP[ 6],Nulo)==true?"":cara+   DadTP[ 6];
PIN = String.Contains(DadTP[ 7],Nulo)==true?"":inve+fx+DadTP[ 7];
DO1 = String.Contains(DadTP[ 8],Nulo)==true?"":domi+fx+DadTP[ 8];
DO2 = String.Contains(DadTP[ 9],Nulo)==true?"":domi+fx+DadTP[ 9];
DO3 = String.Contains(DadTP[10],Nulo)==true?"":domi+fx+DadTP[10];
RP1 = String.Contains(DadTP[11],Nulo)==true?"":rang+fx+DadTP[11];
RP2 = String.Contains(DadTP[12],Nulo)==true?"":rang+fx+DadTP[12];
RAD = String.Contains(DadTP[13],Nulo)==true?"":rang+   DadTP[13];
PHE = String.Contains(DadTP[14],Nulo)==true?"":help+   DadTP[14]+A2;
PRO = PRP+PAN+ PHE+ PC1+PC2+PC3+PIN +DO1+DO2+DO3 +RP1+RP2;
DAP = DAT+DAN+ PHE                  +DO1+DO2+DO3 +RAD;
//------------------------------------------------------------------------
// Prepara INSTANCIAS
//------------------------------------------------------------------------
IAN = anot +       fx+DadTI[1]+A2;
INS = indi +       fx+DadTI[1];
ITI = tipo +       fx+DadTI[2];
IF1 = String.Contains(DadTI[3],Nulo)==true?"":fato+fx+DadTI[3]+" "+fx+DadTI[1];
IF2 = String.Contains(DadTI[4],Nulo)==true?"":fato+fx+DadTI[4]+" "+   DadTI[5];
IND = INS+IAN+ITI+IF1+IF2;
//------------------------------------------------------------------------
// Prepara DISJUNTAS até 10
//------------------------------------------------------------------------
JU01 = String.Contains(DadDI[ 1],Nulo)==true?"":disc+ fx+DadDI[ 1];
JU02 = String.Contains(DadDI[ 2],Nulo)==true?"":", "+ fx+DadDI[ 2];
JU03 = String.Contains(DadDI[ 3],Nulo)==true?"":", "+ fx+DadDI[ 3];
JU04 = String.Contains(DadDI[ 4],Nulo)==true?"":", "+ fx+DadDI[ 4];
JU05 = String.Contains(DadDI[ 5],Nulo)==true?"":", "+ fx+DadDI[ 5];
JU06 = String.Contains(DadDI[ 6],Nulo)==true?"":", "+ fx+DadDI[ 6];
JU07 = String.Contains(DadDI[ 7],Nulo)==true?"":", "+ fx+DadDI[ 7];
JU08 = String.Contains(DadDI[ 8],Nulo)==true?"":", "+ fx+DadDI[ 8];
JU09 = String.Contains(DadDI[ 9],Nulo)==true?"":", "+ fx+DadDI[ 9];
JU10 = String.Contains(DadDI[10],Nulo)==true?"":", "+ fx+DadDI[10];
JU11 = String.Contains(DadDI[11],Nulo)==true?"":", "+ fx+DadDI[11];
JU12 = String.Contains(DadDI[12],Nulo)==true?"":", "+ fx+DadDI[12];
DIS = JU01+JU02+JU03+JU04+JU05+JU06+JU07+JU08+JU09+JU10+JU11+JU12;
//------------------------------------------------------------------------
// Elimina as Nulas e Repetidas e coloca como string
//------------------------------------------------------------------------
LSTE = [ CLA , PRO , DAP , DIS, IND ];
LSTD = [ IND ];
ESQM = String.Concat(List.UniqueItems(List.Flatten( LSTE , 2)));
DADO = String.Concat(List.UniqueItems(List.Flatten( LSTD , 2)));
# ----------------------------------------
cria_e_escreve_arquivo_owl = CodeBlock(fx=formação_dos_axiomas_ontológicos.fx, tema=formação_dos_axiomas_ontológicos.tema, OTXT=formação_dos_axiomas_ontológicos.OTXT, TEXT=formação_dos_axiomas_ontológicos.ESQM)
# ---------- cria_e_escreve_arquivo_owl.designscript (41 lines) ----------
fx;
tema;
OTXT;
TEXT;
NUME = "001";
AOWL = "C:\\JLMenegotto\\Projetos\\OntoBIM\\OntoBIM_"+tema+"_"+NUME+".OWL";
A1   = "\"";
A2   = A1+"@pt";
vi   = ", ";
mion = "\nPrefix: "+fx+" <https://jlmenegotto.wixsite.com/jlmenegotto-bim#>";
//-----------------------------------------------------------------------------
REFE =
"\nPrefix: owl:  <http://www.w3.org/2002/07/owl#>"              +
"\nPrefix: rdfs: <http://www.w3.org/2000/01/rdf-schema#>"       +
"\nPrefix: foaf: <http://xmlns.com/foaf/0.1/#>"                 +
"\nPrefix: rdf:  <http://www.w3.org/1999/02/22-rdf-syntax-ns#>" +
"\nPrefix: xsd:  <http://www.w3.org/2001/XMLSchema#>"           +
"\nPrefix: skos: <http://www.w3.org/2004/02/skos/core#>"        +
"\nPrefix: dc:   <http://purl.org/dc/elements/1.1/>"            +
"\nPrefix: tem:  <http://www.w3.org/2006/time#>"                + mion;
DATA = "\n\nDatatype: xsd:string"   +
         "\nDatatype: xsd:decimal"  +
         "\nDatatype: xsd:double"   +
         "\nDatatype: rdfs:Literal" +
         "\nDatatype: xsd:integer"  +
         "\nDatatype: xsd:dateTime" +
         "\nDatatype: xsd:boolean";
ANNO = "\n\nAnnotationProperty: " +fx+ "Autor"    +
         "\nAnnotationProperty: " +fx+ "Edi_Nome" +
         "\nAnnotationProperty: " +fx+ "Edi_Alias"+
         "\nAnnotationProperty: dc:title";
RAIZ =  "\n\nObjectProperty: "    +fx+ "edificio" +
        "\n\nDataProperty: "      +fx+ "edificio" +
        "\n\nObjectProperty: "    +fx+ "corpos" +
        "\n\nDataProperty: "      +fx+ "corpos" +
        "\n\nObjectProperty: "    +fx+ tema+
        "\n\nDataProperty: "      +fx+ tema+
        "\n\nClass: "             +fx+ "Edificio";
//-----------------------------------------------------------------------------
Todos = REFE + OTXT + DATA + ANNO + RAIZ + TEXT;
FileSystem.WriteText(AOWL, Todos);
# ----------------------------------------
