# Dynamo graph Ontologia_V1_Projeto_HidroSanitário.dyn (Dynamo 2.18.1.5096)

# group: Construtor Ontológico OWL - Revit 2024 Fluxo Geral - HidroSanitário V1.0 > Construtor Ontológico OWL - Revit 2024 Funções - HidroSanitário V1.0
# Desenvolvido por: prof. José Luis Menegotto
# Escola Politécnica da UFRJ
# Departamento de Expressão Gráfica
# Universidade Federal do Rio de Janeiro
função_formação_de_fato = CodeBlock()
# ---------- função_formação_de_fato.designscript (8 lines) ----------
def Fato ( fat , f1 , f2 )
{
  celu   = f1 + " " + f2;
  abce   = fat + celu;
  cond   = String.Contains(celu,"null");
  final  = cond == true ? "" : abce;
  return = final;
};
# ----------------------------------------
função_formação_de_fato_2 = CodeBlock()  # "Função - Formação de Fato - Descrição"
# ---------- função_formação_de_fato_2.designscript (5 lines) ----------
def Descreve ( a , b)
{
  r = "\n\tFacts: rioj:" + a + " " + b;
  return = r;
};
# ----------------------------------------
função_lee_o_arquivo_excel = CodeBlock()
# ---------- função_lee_o_arquivo_excel.designscript (8 lines) ----------
def LerExcel ( Arq , Tab )
{
   dadosIn = DSOffice.Data.ImportExcel(Arq, Tab, true, true);
   valores = List.DropItems( dadosIn , 1    );
   dadosTr = List.Transpose( valores        );
   dadosOu = List.Clean    ( dadosTr , true );
   return dadosOu;
};
# ----------------------------------------
função_concatenar_resultados = CodeBlock()  # "Função - Concatenar Resultados Únicos"
# ---------- função_concatenar_resultados.designscript (8 lines) ----------
def Unicos ( S , n)
{
    LF  = List.Flatten     ( S , n);
    LU  = List.UniqueItems ( LF   );
    ST  = String.Concat    ( LU   );
    return = ST;

};
# ----------------------------------------
função_formar_as_equivalências = CodeBlock()
# ---------- função_formar_as_equivalências.designscript (17 lines) ----------
def EqVt ( fx,  txt , AXI )
{
  Axi = Nula ( txt , AXI );
  s   = String.Split( Axi , " ");
  str = String.Contains (s, "Equiv",0)? s+" " :
        String.Contains (s, "Inver",0)? s+" " :
        String.Contains (s, "xsd:" ,0)? s+" " :
        (s == "some" || s == "only"    ||
         s == "not"  || s == "exactly" ||
         s == "and"  || s == "or"      ||
         s == "("    || s == ")"       ||
         s == "min"  || s == "max"     ||
         s == "10"   || s == "25"      ||
         s == "," )      ? " "+s+" ":
         List.Count(s)>0       ? " "+fx+s :"";
  return = String.Concat( [ str ] );
};
# ----------------------------------------
função_célula_de_excel_é_null = CodeBlock()
# ---------- função_célula_de_excel_é_null.designscript (8 lines) ----------
def Nula ( txt , LIS )
{
  celu   = LIS;
  abce   = txt + celu;
  cond   = String.Contains(celu,"null");
  final  = cond == true ? "" : abce;
  return = final;
};
# ----------------------------------------

# group: Construtor Ontológico OWL - Revit 2024 Fluxo Geral - HidroSanitário V1.0
# Desenvolvido por: prof. José Luis Menegotto
# Escola Politécnica da UFRJ
# Departamento de Expressão Gráfica
# Universidade Federal do Rio de Janeiro
# note: O Construtor precisa fazer a leitura de um arquivo Excel que contem o Campo Ontológico completo com as hierarquias das classes, as equivalências, as propriedades, características e definiçoes terminológias de Propriedades dos Objetos e dos Dados.
# O arquivo Excell pode ser modificado pelo usuário para configurar uma estruturação ontológica de acordo ao seu dominio de conhecimentos e tema de interesse.
# O sistema fica disponível para uso e testes desde que citada a fonte.
# Prof. José Luis Menegotto.
# Escola Politécnica da UFRJ
# PEU - Programa de Pós-graduação em Engenharia Urbana
# PPE - Programa de Pós-graduação em Estrutura
# LEIA COM ATENÇAO:
# 1) A coluna F com as Classes (5) não pode ter elementos repetidos.
# 2) Nenhuma Classe ou Propriedade pode ter Espaços. Foi utilizado o ponto como separador.
# 3)Nomes de Classes em maiúscula
# 4)Nomes de propriedades em minúscula
# 5)Os fatos devem ser extraídos diretamente do modelo. Este nodo é utilizado para testar a formação sintática dos diversos axiomas.
escolher_o_arquivo_excel_classes = Filename(".\Ontologia_V1_Projeto_HidroSanitário_Classes_Propriedades.xlsx")  # "Escolher o arquivo Excel Classes - Propriedades e Disjuntas"
arquivo_1 = FileObject(path=escolher_o_arquivo_excel_classes)
escolher_o_arquivo_excel_com = Filename(".\Ontologia_V1_Projeto_HidroSanitário.xlsx")  # "Escolher o arquivo Excel com Dados do projeto e Instancias"
arquivo_2 = FileObject(path=escolher_o_arquivo_excel_com)
directoryName = FileSystem.DirectoryName(path=escolher_o_arquivo_excel_com)
leitura_de_dados_e_preparação_de = CodeBlock(AXLS1=arquivo_1, AXLS2=arquivo_2, Pasta=directoryName)  # "LEITURA DE DADOS E PREPARAÇÃO DE ELEMENTOS TEXTUAIS"
# ---------- leitura_de_dados_e_preparação_de.designscript (76 lines) ----------
AXLS1;
AXLS2;
Pasta;
DadTC = LerExcel ( AXLS1 , "Classes" );
DadTP = LerExcel ( AXLS1 , "Proprie" );
DadDI = LerExcel ( AXLS1 , "Disjunt" );
DaPRJ = LerExcel ( AXLS2 , "Projeto" );
DadFA = LerExcel ( AXLS2 , "FatosIn" );

key   = ["DAPRJ","DACLA","DAPRO","DAFAT","DADIS"];
val   = [ DaPRJ , DadTC , DadTP , DadFA , DadDI ];
//-------------------------------------------------
// SAIDAS
//-------------------------------------------------
DADOS = Dictionary.ByKeysValues (key , val);
DCLA;
DDOM;
DANO;
DESP;
DCAR;
DFAT;
//-------------------------------------------------
//Classes e propriedades --------------------------
clas = "\n\nClass: ";
subc = "\n\tSubClassOf: ";
obje = "\n\nObjectProperty: ";
subp = "\n\tSubPropertyOf: ";
data = "\n\nDataProperty: ";
//Dominio -----------------------------------------
domi = "\n\tDomain: ";
rang = "\n\tRange: ";
equi = "\n\tEquivalentTo: ";
//Individuos --------------------------------------
chav = "\n\tHasKey: ";
indi = "\n\nIndividual: ";
tipo = "\n\tTypes: ";
fato = "\n\tFacts: ";
impo = "\n\nImport: ";
//Disjunções --------------------------------------
anot = "\n\tAnnotations: rdfs:label \"";
help = "\n\tAnnotations: rdfs:label \"";
disc = "\n\nDisjointClasses: ";
disu = "\n\tDisjointUnionOf: ";
disj = "\n\tDisjointWith: ";
//Espaciais ---------------------------------------
aspa = "\"";
espa = "\n";
id   = aspa+"@pt";
vi   = ", ";
//Caracteristicas ---------------------------------
cara = "\n\tCharacteristics: ";
inve = "\n\tInverseOf: ";
// Dicionário Classes e propriedades --------------
kax  = ["clas","subc","obje","subp","data"];
vax  = [ clas , subc , obje , subp , data ];
DCLA = Dictionary.ByKeysValues( kax , vax );
// Dicionário de Dominio --------------------------
kdo  = ["domi","rang","equi"];
vdo  = [ domi , rang , equi];
DDOM = Dictionary.ByKeysValues( kdo , vdo );
// Dicionário de Anotações-------------------------
kan  = ["anot","help","disc","disu","disj"];
van  = [ anot , help , disc , disu , disj ];
DANO = Dictionary.ByKeysValues( kan , van );
// Dicionário de Espaciais ------------------------
kes  = ["aspa","espa","idio","virg"];
ves  = [ aspa , espa , id   , vi   ];
DESP = Dictionary.ByKeysValues( kes , ves );
// Dicionário de Caracteristicas ------------------
kca  = ["cara","inve"];
vca  = [ cara , inve ];
DCAR = Dictionary.ByKeysValues( kca, vca );
// Dicionário de Individuos -----------------------
kin  = ["chav","indi","tipo","fato","impo", "pasta"];
vin  = [ chav , indi , tipo , fato , impo ,  Pasta];
DFAT = Dictionary.ByKeysValues( kin , vin );
# ----------------------------------------
formação_dos_axiomas_ontológicos = CodeBlock(DADOS=leitura_de_dados_e_preparação_de.out10, DCLA=leitura_de_dados_e_preparação_de.out11, DDOM=leitura_de_dados_e_preparação_de.out12, DANO=leitura_de_dados_e_preparação_de.out13, DESP=leitura_de_dados_e_preparação_de.out14, DCAR=leitura_de_dados_e_preparação_de.out15, DFAT=leitura_de_dados_e_preparação_de.out16)
# ---------- formação_dos_axiomas_ontológicos.designscript (93 lines) ----------
DADOS;
DCLA;
DDOM;
DANO;
DESP;
DCAR;
DFAT;
DicI;
//----------------------------------------------------------
// Prepara Informações do Projeto
//----------------------------------------------------------
DPJT = DADOS["DAPRJ"];
DACL = DADOS["DACLA"];
DPRO = DADOS["DAPRO"];
DISJ = DADOS["DADIS"];
keyP = DPJT [0];
valP = DPJT [1];
fx   = valP [0];
tema = valP [1];
rzcl = valP [2];
rzpr = valP [3];
rzda = valP [4];
uri  = valP [5];
aut  = valP [6];
clas = DCLA ["clas"]+fx;
subc = DCLA ["subc"]+fx;
obje = DCLA ["obje"]+fx;
data = DCLA ["data"]+fx;
equi = DDOM ["equi"]+fx;
help = DANO ["help"];
aspa = DESP ["aspa"];
vi   = DESP ["virg"];
id   = DESP ["idio"];
//----------------------------------------------------------
// Prepara Prefixos e Raizes
//----------------------------------------------------------
qo   = List.Count(keyP)-1;
io   = 0..qo;
fo   = qo==io?"":vi;
PRFX =
"\nPrefix: owl:  <http://www.w3.org/2002/07/owl#>"             +
"\nPrefix: rdfs: <http://www.w3.org/2000/01/rdf-schema#>"      +
"\nPrefix: foaf: <http://xmlns.com/foaf/0.1/#>"                +
"\nPrefix: rdf:  <http://www.w3.org/1999/02/22-rdf-syntax-ns#>"+
"\nPrefix: xsd:  <http://www.w3.org/2001/XMLSchema#>"          +
"\nPrefix: skos: <http://www.w3.org/2004/02/skos/core#>"       +
"\nPrefix: dc:   <http://purl.org/dc/elements/1.1/>"           +
"\nPrefix: tem:  <http://www.w3.org/2006/time#>"               +
"\nPrefix: "+fx+" <"+uri     +">"+
"\n\nOntology: <"   +uri+tema+">";

SITE = "<https://jlmenegotto.wixsite.com/jlmenegotto-bim#";
pont = "\n\nImport: " + SITE;
IMPO =
// pont + "Parte_2_0M>";
// pont + "Parte_2_0P>"+
// pont + "Parte_3_1D>";
// pont + "Parte_3_1F>"+
// pont + "Parte_3_1S>"+
// pont + "Parte_4_2C>"+
// pont + "Parte_4_2N>"+
// pont + "Parte_4_2Q>"+
// pont + "Parte_5_3E>"+
// pont + "Parte_5_3R>"+
// pont + "Parte_6_4A>"+
// pont + "Parte_6_4U>"+
// pont + "Parte_7_5I>";
"";

ETIQ = "\n\trdfs:label " +aspa+keyP + ": " +valP+id+fo;
CABE = "\n\nAnnotations: " + String.Concat( [ ETIQ ] );
ANOT = "\n\nDatatype: xsd:string"       +
         "\nDatatype: xsd:decimal"      +
         "\nDatatype: xsd:double"       +
         "\nDatatype: rdfs:Literal"     +
         "\nDatatype: rdf:PlainLiteral" +
         "\nDatatype: xsd:integer"      +
         "\nDatatype: xsd:dateTime"     +
         "\nDatatype: xsd:boolean";

RAIZ = clas+rzcl+help+ "Raiz das Classes"     +id+
       obje+rzpr+help+ "Raiz das Propriedades"+id+
       data+rzda+help+ "Raiz dos Data"        +id;

CLA =       clas+DACL[1];
SUB =       subc+rzcl;
HEL = Nula (help , DACL[11]);
LIN = CLA+SUB+HEL+id;
CLI = Unicos( LIN , 2);

key  = ["TEMA", "PREF", "IMPO", "CABE", "ANOT", "RAIZ", "CLAI"];
val  = [ tema ,  PRFX ,  IMPO ,  CABE ,  ANOT ,  RAIZ ,  CLI  ];
DicI = Dictionary.ByKeysValues (key , val);
# ----------------------------------------
preparação_das_classes = CodeBlock(DADOS=formação_dos_axiomas_ontológicos.out0, DCLA=formação_dos_axiomas_ontológicos.out1, DDOM=formação_dos_axiomas_ontológicos.out2, DANO=formação_dos_axiomas_ontológicos.out3, DESP=formação_dos_axiomas_ontológicos.out4, DCAR=formação_dos_axiomas_ontológicos.out5, DFAT=formação_dos_axiomas_ontológicos.out6, DicI=formação_dos_axiomas_ontológicos.out7)
# ---------- preparação_das_classes.designscript (44 lines) ----------
DADOS;
DCLA;
DDOM;
DANO;
DESP;
DCAR;
DFAT;
DicI;
DicC;
//-----------------------------------
// Prepara dados do Classes
//-----------------------------------
DPJT = DADOS["DAPRJ"];
DACL = DADOS["DACLA"];
DPRO = DADOS["DAPRO"];
DISJ = DADOS["DADIS"];
keyP = DPJT [0];
valP = DPJT [1];
fx   = valP [0];
clas = DCLA ["clas"];
subc = DCLA ["subc"];
equi = DDOM ["equi"];
help = DANO ["help"];
id   = DESP ["idio"];
vi   = DESP ["virg"];
disc = DANO ["disc"];
//-----------------------------------
// CLASSES
//-----------------------------------
c    = 2..5;
CLAS = clas+fx+DACL[c   ];
OSUB = subc+fx+DACL[c- 1];
EQUI = EqVt (fx,equi , DACL[c+ 5]);
//EQUI = "";
HELP = Nula (   help , DACL[c+10]);
//-----------------------------------
OCLA = CLAS+OSUB+HELP+id+EQUI;
UCLA = Unicos ( OCLA , 2);
//-----------------------------------
// REGISTRA FINAIS DE CLASSES
//-----------------------------------
kc   = [ "CLAS" ];
vc   = [  UCLA  ];
DicC = Dictionary.ByKeysValues(kc,vc);
# ----------------------------------------
preparação_das_propriedades = CodeBlock(DADOS=preparação_das_classes.out0, DCLA=preparação_das_classes.out1, DDOM=preparação_das_classes.out2, DANO=preparação_das_classes.out3, DESP=preparação_das_classes.out4, DCAR=preparação_das_classes.out5, DFAT=preparação_das_classes.out6, DicI=preparação_das_classes.out7, DicC=preparação_das_classes.out8)
# ---------- preparação_das_propriedades.designscript (74 lines) ----------
DADOS;
DCLA;
DDOM;
DANO;
DESP;
DCAR;
DFAT;
DicI;
DicC;
DicP;
//-----------------------------------
// Prepara dados de Propriedades
//-----------------------------------
DPJT = DADOS["DAPRJ"];
DACL = DADOS["DACLA"];
DPRO = DADOS["DAPRO"];
keyP = DPJT [0];
valP = DPJT [1];
fx   = valP [0];
obje = DCLA ["obje"]+fx;
suop = DCLA ["subp"]+fx;
sudp = DCLA ["subp"]+fx;
data = DCLA ["data"]+fx;
anot = DANO ["anot"];
equi = DDOM ["equi"]+fx;
domi = DDOM ["domi"]+fx;
rang = DDOM ["rang"]+fx;
vran = DDOM ["rang"];
help = DANO ["help"];
vi   = DESP ["virg"];
id   = DESP ["idio"];
cara = DCAR ["cara"];
inve = DCAR ["inve"];
//-----------------------------------
// PROPRIEDADES DOS OBJETOS
//-----------------------------------
PROP =          obje + DPRO[ 5];
OSUB =          suop + DPRO[ 4];
CA01 = Nula (   cara , DPRO[ 6]);
CA02 = Nula (   cara , DPRO[ 7]);
CA03 = Nula (   cara , DPRO[ 8]);
CA04 = Nula (   cara , DPRO[ 9]);
CA05 = Nula (   cara , DPRO[10]);
CA06 = Nula (   cara , DPRO[11]);
CA07 = Nula (   cara , DPRO[12]);
CA08 = EqVt (fx,inve , DPRO[13]);
EQUI = Nula (   equi , DPRO[14]);
DOMI = Nula (   domi , DPRO[15]);
RANG = Nula (   rang , DPRO[16]);
HELP =          help + DPRO[17];
//-----------------------------------
OPRO = PROP+OSUB+EQUI+
       CA01+CA02+CA03+CA04+CA05+CA06+
       CA07+CA08+DOMI+RANG+HELP+id;
OPRU = Unicos ( OPRO , 2);
//-----------------------------------
// DATA DOS OBJETOS
//-----------------------------------
DATA =        data + DPRO[  2];
DASU =        sudp + DPRO[  1];
DAHE =        help + DPRO[ 18];
COME =        anot + DPRO[ 20];
DADO = Nula ( domi , DPRO[ 15]);
DARA = Nula ( vran , DPRO[  3]);
DACA = Nula ( cara , DPRO[ 19]);
ODAT = DATA+DASU+DADO+DARA+
       DACA+DAHE+id+COME+id;
ODAU = Unicos ( ODAT , 2);
//-----------------------------------
// REGISTRA FINAIS DE PROPRIEDADES
//-----------------------------------
kp   = ["PROP", "DATA"];
vp   = [ OPRU ,  ODAU ];
DicP = Dictionary.ByKeysValues(kp,vp);
# ----------------------------------------
preparação_das_disjuntas = CodeBlock(DADOS=preparação_das_propriedades.out0, DCLA=preparação_das_propriedades.out1, DDOM=preparação_das_propriedades.out2, DANO=preparação_das_propriedades.out3, DESP=preparação_das_propriedades.out4, DCAR=preparação_das_propriedades.out5, DFAT=preparação_das_propriedades.out6, DicI=preparação_das_propriedades.out7, DicC=preparação_das_propriedades.out8, DicP=preparação_das_propriedades.out9)
# ---------- preparação_das_disjuntas.designscript (35 lines) ----------
DADOS;
DCLA;
DDOM;
DANO;
DESP;
DCAR;
DFAT;
DicI;
DicC;
DicP;
DicD;
//-----------------------------------
// Prepara dados de Disjuntas
//-----------------------------------
DPJT = DADOS["DAPRJ"];
DISJ = DADOS["DADIS"];
keyP = DPJT [0];
valP = DPJT [1];
fx   = valP [0];
vi   = DESP ["virg"];
disc = DANO ["disc"];
//-----------------------------------
// DISJUNTAS (ate 20)
//-----------------------------------
d   = 1..20;
DJI = d==1? Nula( disc+fx,DISJ[d]):
            Nula(   vi+fx,DISJ[d]);
DJC = String.Concat(Transpose(DJI));
UDJ = Unicos ( DJC , 3 );
//-----------------------------------
// REGISTRA FINAIS DE DISJUNTAS
//-----------------------------------
kj   = ["DISJ"];
vj   = [ UDJ  ];
DicD = Dictionary.ByKeysValues(kj,vj);
# ----------------------------------------
preparação_dos_fatos_de = CodeBlock(DADOS=preparação_das_disjuntas.out0, DCLA=preparação_das_disjuntas.out1, DDOM=preparação_das_disjuntas.out2, DANO=preparação_das_disjuntas.out3, DESP=preparação_das_disjuntas.out4, DCAR=preparação_das_disjuntas.out5, DFAT=preparação_das_disjuntas.out6, DicI=preparação_das_disjuntas.out7, DicC=preparação_das_disjuntas.out8, DicP=preparação_das_disjuntas.out9, DicD=preparação_das_disjuntas.out10)  # "PREPARAÇÃO DOS FATOS DE INDIVÍDUOS"
# ---------- preparação_dos_fatos_de.designscript (73 lines) ----------
DADOS;
DCLA;
DDOM;
DANO;
DESP;
DCAR;
DFAT;
DicI;
DicC;
DicP;
DicD;
//-----------------------------------
// Prepara dados de Fatos
//-----------------------------------
DPJT  = DADOS["DAPRJ"];
DIFA  = DADOS["DAFAT"];
keyP  = DPJT [0];
valP  = DPJT [1];
fx    = valP [0];
id    = DESP ["idio"];
help  = DANO ["help"];
indi  = DFAT ["indi"];
tipo  = DFAT ["tipo"];
fato  = DFAT ["fato"];
pasta = DFAT ["pasta"];
//-----------------------------------
// FATOS INSTÂNCIAS (10 obj e 10 data
//-----------------------------------
IFA  = indi+       fx+DIFA[ 1];
TFA  = tipo+       fx+DIFA[ 2];
FA1  = Fato( fato, fx+DIFA[ 3], fx+DIFA[ 4]);
FA2  = Fato( fato, fx+DIFA[ 5], fx+DIFA[ 6]);
FA3  = Fato( fato, fx+DIFA[ 7], fx+DIFA[ 8]);
FA4  = Fato( fato, fx+DIFA[ 9], fx+DIFA[10]);
FA5  = Fato( fato, fx+DIFA[11], fx+DIFA[12]);
FA6  = Fato( fato, fx+DIFA[13],    DIFA[14]);
FA7  = Fato( fato, fx+DIFA[15],    DIFA[16]);
FA8  = Fato( fato, fx+DIFA[17],    DIFA[18]);
FA9  = Fato( fato, fx+DIFA[19],    DIFA[20]);
FA0  = Fato( fato, fx+DIFA[21],    DIFA[22]);
HTO  = help+ String.Replace(DIFA[22],"\"","")+id;
//-----------------------------------
FAT  = IFA+HTO+TFA+FA1+FA2+FA3+FA4+FA5+
                   FA6+FA7+FA8+FA9+FA0;
UFA  = Unicos( FAT , 2);
//-----------------------------------
// REGISTRA FINAIS DE FATOS
//-----------------------------------
kf   = ["FATO"];
vf   = [ UFA  ];
DicF = Dictionary.ByKeysValues(kf,vf);
//---------------------------------
// REGISTRA TODO
//---------------------------------
TODO = [   DicI["PREF"]
         , DicI["IMPO"]
         , DicI["CABE"]
         , DicI["ANOT"]
         , DicI["RAIZ"]
         , DicI["CLAI"]
         , DicC["CLAS"]
         , DicP["PROP"]
         , DicP["DATA"]
         , DicD["DISJ"]
         , DicF["FATO"]
       ];
UTEXT = String.Concat(List.UniqueItems(
                           List.Flatten(TODO , 3)));
//---------------------------------
// ESCREVE ARQUIVO OWL
//---------------------------------
Aowl = pasta+"\\Ontologia_V1_Projeto_HidroSanitário.OWL";
FileSystem.WriteText ( Aowl , UTEXT);
# ----------------------------------------
